# Grasshopper definition ExampleFile.gh (Grasshopper 1.0.8)
# plug-ins: ParkingDemo

curve = Curve([<curve referenced from the Rhino model> x5])
curve_2 = Curve(<curve referenced from the Rhino model>)

start_generation = StartGeneration(Outline=curve_2, ExcludeBoundaries=curve, AddRamp=False, EntranceSide=0, GenerationInterval=500, WasRunning=False)
boolean_toggle = BooleanToggle(True)
block_instance = BlockInstance(<block instance referenced from the Rhino model>)
sortresults = SortResults(ResetGeneration=Toggle(False), Parking=start_generation)  # -> Parking, GenerationCollection
deconstruct_parking_collection = DeconstructParkingCollection(GenerationCollection=sortresults.GenerationCollection)  # -> Ids, Scores
panel = Panel(sortresults.GenerationCollection)
list_item = ListItem(List=deconstruct_parking_collection.Ids, Index=Slider(5, range=0..10), Wrap=True)
selectparking = SelectParking(Generations=sortresults.GenerationCollection, ParkingId=list_item)
bake_parking_result = BakeParkingResult(
    Parking=selectparking,
    CarBlock=block_instance,
    BakeCars=boolean_toggle,
    BakeGradientCells=boolean_toggle,
    BakePath=boolean_toggle,
    BakeExcludedCells=boolean_toggle,
    BakeEntranceCell=boolean_toggle,
    BakeWalls=boolean_toggle)
bake_parking_result_2 = BakeParkingResult(Parking=selectparking, CarBlock=block_instance)
