# Grasshopper definition TestForOutput.gh (Grasshopper 1.0.7)
# plug-ins: ParkingDemo, Heteroptera

crv = Curve(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)
curve = Curve(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)

curve_2 = Curve(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)
curve_3 = Curve(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)

crv_2 = Curve(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)

crv_3 = Curve(reparameterize(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))
crv_4 = Curve(reparameterize(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))
crv_5 = Curve(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)
crv_6 = Curve(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)
crv_7 = Curve(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)
crv_8 = Curve(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)
crv_9 = Curve(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)
crv_10 = Curve(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)
crv_11 = Curve(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)
rec = Rectangle({Plane=PlaneXY(-36.17804932, 8.812579263, 0), Size=Domain2(u=-30.67905678..30.67905678, v=-35.06732629..35.06732629)})
crv_12 = Curve(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)
crv_13 = Curve(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)
crv_14 = Curve(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)
crv_15 = Curve(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)
crv_16 = Curve(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)
crv_17 = Curve(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)
crv_18 = Curve(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)
crv_19 = Curve(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)
crv_20 = Curve(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)
crv_21 = Curve(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)
crv_22 = Curve(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)
crv_23 = Curve(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)
crv_24 = Curve(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)
crv_25 = Curve(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)
crv_26 = Curve(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)

# ----
# Generation Collections
data = Data("Grasshopper.Kernel.Types.GH_ObjectWrapper")

trigger = Trigger(Interval=500, TimerInterval=500, Target=[startgeneration, expression])  # disabled
trigger_2 = Trigger(Interval=-1000, TimerInterval=1000)
startgeneration = StartGeneration(AddRampToParking=Toggle(False), Outline=crv, ExcludeBoundary=curve, EntranceSide=Slider(3, range=0..3))
deconstrucparking = DeconstrucParking(Parking=startgeneration)  # -> Score, PlanMatrix, PathPoints, LotInformations, Cells, SideCellsAddress, EXcludedCells, PlanOutline, RampInfo
pathfinder = PathFinder(ResetGeneration=Toggle(False), Parking=startgeneration)  # -> Parking, GenerationCollection
button = Button()
setoptimizationweights = SetOptimizationWeights(
    ParkingColleciton=pathfinder.GenerationCollection,
    NumberOfParkings=Slider(1, range=0..1),
    TotalPathLength=Slider(0.4, range=0..1),
    MinimumNonFunctionalCells=Slider(1, range=0..1))
deconstruct_parking_collection = DeconstructParkingCollection(GenerationCollection=setoptimizationweights)  # -> Ids, Scores
panel = Panel(deconstruct_parking_collection.Ids)
sort_list = SortList(Keys=deconstruct_parking_collection.Scores, ValuesValuesA=deconstruct_parking_collection.Ids)  # -> reverse(Keys), ValuesValuesA
number_slider = Slider(0, range=0..5)
list_item = ListItem(List=reverse(sort_list.ValuesValuesA), Index=number_slider, Wrap=True)
list_item_2 = ListItem(List=reverse(sort_list.Keys), Index=number_slider, Wrap=True)
panel_2 = Panel(list_item_2)
selectparking = SelectParking(Generations=setoptimizationweights, ParkingId=list_item)
deconstrucparking_2 = DeconstrucParking(Parking=pathfinder.Parking)  # -> Score, PlanMatrix, PathPoints, LotInformations, Cells, SideCellsAddress, EXcludedCells, PlanOutline, RampInfo
parking_score = Panel(deconstrucparking_2.Score)
display_matrix = DisplayMatrix(deconstrucparking_2.PlanMatrix)
pathpts = Data(flatten(deconstrucparking_2.PathPoints))
data_2 = Data(deconstrucparking_2.PathPoints)
columngridgenerator = ColumnGridGenerator(Parking=pathfinder.Parking)  # -> H, V, Parking
# column grid
cluster = Cluster_8(
    x_coordinate=columngridgenerator.V,
    y_coordinate=columngridgenerator.H,
    curve=deconstrucparking_2.PlanOutline,
    Panel=columngridgenerator.V)  # -> surface_2, colour_swatch
# path display
cluster_2 = Cluster_5(relay=deconstrucparking_2.PathPoints)  # -> geometry, colour_swatch
# cells address
cluster_3 = Cluster_4(data_3=deconstrucparking_2.Cells, data=deconstrucparking_2.Cells, matrix=deconstrucparking_2.PlanMatrix)  # -> D, geometry, paths, panel_3, colour_swatch
# ramp display
generalrampinformation = GeneralRampInformation()  # -> RampTypes, RampOrientations
# print result and display cells
cluster_4 = Cluster_7(geometry=deconstrucparking_2.PlanOutline, curve=deconstrucparking_2.PlanOutline)  # -> test_locs, curve_2, brep, colour_swatch
# parking lots display
cluster_5 = Cluster(T_2=deconstrucparking_2.LotInformations, T=deconstrucparking_2.LotInformations)  # -> data_4, swatch_2, data_3, swatch
expression = Expression(Expression="true")
cluster_6 = Cluster_3(
    L=deconstrucparking_2.RampInfo,
    L_2=generalrampinformation.RampOrientations,
    T=deconstrucparking_2.SideCellsAddress,
    T_2=generalrampinformation.RampTypes)  # -> G_2, swatch, C, G
file_path = FilePath("G:\archtech\thesis\FatemeThesis\Visualization\imcap\sample parkings\parking03\")

# ----
# Export jpeg
data_dam = DataDam(DataDataA=cluster_4.curve_2, BufferDelay=100000000, BufferMode=0)
data_dam_2 = DataDam(DataDataA=expression, BufferDelay=5000000, BufferMode=2)
printresult = PrintResult(SaveFolderPath=file_path, OutlineBoundingRectangle=data_dam, ParkingName="Parking06", ResetPreviewSheet=data_dam_2)

preview = CustomPreview(Geometry=cluster_6.G_2, Material=cluster_6.C)
preview_2 = CustomPreview(Geometry=cluster_6.G, Material=cluster_6.swatch)
preview_3 = CustomPreview(Geometry=cluster_5.data_4, Material=cluster_5.swatch_2)
preview_4 = CustomPreview(Geometry=cluster_5.data_3, Material=cluster_5.swatch)
custom_preview = CustomPreview(Geometry=cluster_2.geometry, Material=cluster_2.colour_swatch)
custom_preview_2 = CustomPreview(Geometry=cluster_3.D, Material=cluster_3.colour_swatch)
text_tag_3d = TextTag3D(
    Location=cluster_3.geometry,
    Text=graft(cluster_3.paths),
    Size=cluster_3.panel_3,
    Colour=cluster_3.colour_swatch,
    Justification=5)
custom_preview_3 = CustomPreview(Geometry=cluster_4.brep, Material=cluster_4.colour_swatch)
custom_preview_4 = CustomPreview(Geometry=cluster.surface_2, Material=cluster.colour_swatch)
surface = Surface(deconstrucparking_2.EXcludedCells)
region_union = RegionUnion(Curves=surface)
area = Area(Geometry=region_union)  # -> Area, Centroid
panel_3 = Panel(""" vertical
 access""")
number_slider_2 = Slider(0.2, range=0..1)
custom_preview_5 = CustomPreview(Geometry=surface, Material=ColourSwatch(SwatchColor=RGBA(0, 0, 0, 217)))
text_tag = TextTag(Location=area.Centroid, Text=panel_3, Colour=ColourSwatch(SwatchColor=RGB(242, 242, 242)))

# ----
# path display
point_in_curve = PointInCurve(Point=pathpts, Curve=graft(deconstrucparking_2.EXcludedCells))  # -> Relationship, Point
explode_tree = ExplodeTree(Data=point_in_curve.Relationship)  # -> Branch0, Branch1, Branch2, Branch3
addition = Addition(A=explode_tree.Branch0, B=explode_tree.Branch1, C=explode_tree.Branch2, D=explode_tree.Branch3)
equality = Equality(FirstNumber=addition, SecondNumber="0")  # -> Equality, Inequality
point_in_curve_2 = PointInCurve(Point=pathpts, Curve=deconstrucparking_2.PlanOutline)  # -> Relationship, Point
equality_2 = Equality(FirstNumber=point_in_curve_2.Relationship, SecondNumber="2")  # -> Equality, Inequality
gate_and = GateAnd(A=equality_2.Equality, B=equality.Equality)
dispatch = Dispatch(List=pathpts, DispatchPattern=gate_and)  # -> ListA, ListB
mst = MST(BasePoints=dispatch.ListA)  # -> PointPointTopology, ConnectionPointTopology, Lines

number_slider_3 = Slider(0.3, range=0..1)
join_curves = JoinCurves(Curves=mst.Lines, Preserve=False)
offset_curve = OffsetCurve(Curve=join_curves, Distance=expr("-x", number_slider_3), Corners=1)
offset_curve_2 = OffsetCurve(Curve=join_curves, Distance=number_slider_3, Corners=1)
end_points = EndPoints(Curve=offset_curve_2)  # -> Start, End
end_points_2 = EndPoints(Curve=offset_curve)  # -> Start, End
line = Line(StartPoint=end_points.Start, EndPoint=end_points_2.Start)
line_2 = Line(StartPoint=end_points.End, EndPoint=end_points_2.End)
join_curves_2 = JoinCurves(Curves=[offset_curve_2, offset_curve, line, line_2], Preserve=False)
region_union_2 = RegionUnion(Curves=flatten(join_curves_2))
fillet_distance = FilletDistance(Curve=region_union_2, Distance=Slider(0.2, range=0..1))
surface_2 = Surface(fillet_distance)

# ---- group: lable
# add lable to results
length = Length(Curve=mst.Lines)
mass_addition = MassAddition(Input=length)  # -> Result, PartialResults
area_2 = Area(Geometry=deconstrucparking_2.PlanOutline)  # -> Area, Centroid
list_length = ListLength(List=flatten(deconstrucparking_2.LotInformations))  # -> expr("x*2", Length)
area_3 = Area(Geometry=deconstrucparking_2.PlanOutline)  # -> Area, Centroid
round = Round(Number=mass_addition.Result)  # -> Nearest, Floor, Ceiling
concatenate = Concatenate(FragmentA=" Parking Count:", FragmentB=list_length)
concatenate_2 = Concatenate(FragmentA="Path Length: ", FragmentB=round.Nearest)
concatenate_3 = Concatenate(FragmentA="Parking Score: ", FragmentB=deconstrucparking_2.Score)
concatenate_4 = Concatenate(Fragment_A="Internal Outline Area: ", Fragment_B=area_3.Area, A="m2")
text_tag_3d_2 = TextTag3D(
    Location=cluster_4.test_locs,
    Text=flatten([concatenate, concatenate_4, concatenate_2, concatenate_3]),
    Size="1",
    Colour=cluster_3.colour_swatch,
    Justification=4)

# ----
panel_4 = Panel("""1.5
1""")
number_slider_4 = Slider(0.1, range=0..0.1)
dash_pattern = DashPattern(Curve=join_curves, Pattern=panel_4)  # -> Dashes, Gaps
panel_5 = Panel(".04")
offset_curve_3 = OffsetCurve(Curve=dash_pattern.Dashes, Distance=expr("-x", number_slider_2), Corners=1)
offset_curve_4 = OffsetCurve(Curve=dash_pattern.Dashes, Distance=number_slider_2, Corners=1)
end_points_3 = EndPoints(Curve=offset_curve_4)  # -> Start, End
end_points_4 = EndPoints(Curve=offset_curve_3)  # -> Start, End
line_3 = Line(StartPoint=end_points_3.Start, EndPoint=end_points_4.Start)
line_4 = Line(StartPoint=end_points_3.End, EndPoint=end_points_4.End)
join_curves_3 = JoinCurves(Curves=[line_3, line_4, offset_curve_4, offset_curve_3], Preserve=False)
panel_6 = Panel("11,11,45")
surface_3 = Surface(join_curves_3)

list_length_2 = ListLength(List=flatten(surface_2))

custom_preview_6 = CustomPreview(Geometry=surface_2, Material="229,229,26")
custom_preview_7 = CustomPreview(Geometry=surface_3, Material="229,229,26")

expression_2 = Expression(x=list_length_2, Expression="x≠0")

# ==== cluster Cluster
T = ClusterInput()
T_2 = ClusterInput()

# ----
# parking lots display
crv = Curve([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])
surface = Surface([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])
rotate = Rotate(Geometry=crv, Angle=degrees("180"), Plane=PlaneXY(0, 0, 0))  # -> Geometry, Transform
rotate_2 = Rotate(Geometry=surface, Angle=degrees("180"), Plane=PlaneXY(0, 0, 0))  # -> Geometry, Transform
crv_2 = Curve(rotate_2.Geometry)
transform = Transform(Geometry=rotate.Geometry, Transform=T)
transform_2 = Transform(Geometry=rotate_2.Geometry, Transform=T_2)
data = Data(transform)
data_2 = Data(transform_2)

data_3 = ClusterOutput(data)
data_4 = ClusterOutput(data_2)
swatch = ClusterOutput(ColourSwatch(SwatchColor=RGB(9, 10, 9)))
swatch_2 = ClusterOutput(ColourSwatch(SwatchColor=RGB(200, 224, 202)))

# ==== cluster Cluster_3
T = ClusterInput()
L = ClusterInput()
T_2 = ClusterInput()
L_2 = ClusterInput()

# ----
# ramp info:
# 0: side
# 1: cell index on its side
# 2: ramp type
# 3: orientation
item = ListItem(List=L, Index=0, Wrap=True)  # -> Item, Item1, Item2, Item3

branch = TreeBranch(Tree=T, Path=item.Item, MaintainPaths=True)
branch_2 = TreeBranch(Tree=T_2, Path=item.Item2, MaintainPaths=True)
number_slider = Slider(5, range=0..10)
item_2 = ListItem(List=branch, Index=item.Item1, Wrap=True)
multiplication = Multiplication(A=branch_2, B=5)
addition = Addition(A=multiplication, B=item_2, C="{-2.5,-2.5,0}")
rectangle = Rectangle(Plane=addition, XSize=number_slider, YSize=number_slider, Radius=0)  # -> Rectangle, Length
item_3 = ListItem(List=rectangle.Rectangle, Index=0, Wrap=True)
boundary = BoundarySurfaces(Edges=rectangle.Rectangle)
lng = ListLength(List=rectangle.Rectangle)
area = Area(Geometry=item_3)  # -> Area, Centroid
cluster = Cluster_2(i=item.Item2, T="{-2.5,-2.5,0}")
range = Range(Domain="0 to 0.8", Steps=expr("x-1", lng))  # -> reverse(Range)
item_4 = ListItem(List=L_2, Index=item.Item3, Wrap=True)
move = Move(Geometry=boundary, Motion=expr("-x", area.Centroid))  # -> Geometry, Transform
gradient = Gradient(LowerLimit=0, UpperLimit=1, Parameter=range, stops=[0: RGB(192, 0, 0), 0: RGB(255, 255, 255), 1: RGB(128, 128, 128)])
transform = Transform(Geometry=move.Geometry, Transform=item_4)
transform_2 = Transform(Geometry=cluster, Transform=item_4)
move_2 = Move(Geometry=transform, Motion=area.Centroid)  # -> Geometry, Transform
move_3 = Move(Geometry=transform_2, Motion=area.Centroid)  # -> Geometry, Transform
swatch = ClusterOutput(ColourSwatch(SwatchColor=RGB(186, 168, 168)))
G = ClusterOutput(move_3.Geometry)
G_2 = ClusterOutput(move_2.Geometry)
C = ClusterOutput(gradient)

# ==== cluster Cluster_4
data = ClusterInput()
data_2 = Data(data)
matrix = ClusterInput()
data_3 = ClusterInput()

deconstruct_matrix = DeconstructMatrix(Matrix=matrix)  # -> Rows, Columns, Values
plasticanchor = PlasticAnchor(Limit=1, Strength=1, Reset=False)
data_4 = Data(data_3)
partition_list = PartitionList(List=deconstruct_matrix.Values, Size=deconstruct_matrix.Columns)
area = Area(Geometry=data_4)  # -> Area, Centroid
partition_list_2 = PartitionList(List=partition_list, Size="1")  # -> simplify(Chunks)

# ---- group: to remove 0 items in matrix
equality = Equality(FirstNumber=partition_list_2, SecondNumber=0)  # -> Equality, Inequality
tree_statistics = TreeStatistics(Tree=partition_list_2)  # -> Paths, Length, Count
dispatch = Dispatch(List=tree_statistics.Paths, DispatchPattern=flatten(equality.Inequality))  # -> ListA, ListB
tree_branch = TreeBranch(Tree=partition_list_2, Path=dispatch.ListA, MaintainPaths=True)

# ----
tree_statistics_2 = TreeStatistics(Tree=area.Centroid)  # -> Paths, Length, Count
tree_branch_2 = TreeBranch(Tree=partition_list_2, Path=tree_statistics_2.Paths, MaintainPaths=True)
move = Move(Geometry=area.Centroid, Motion="-1.7,-1.7,0")  # -> Geometry, Transform
tree_statistics_3 = TreeStatistics(Tree=tree_branch_2)  # -> Paths, Length, Count
panel = Panel("1")

panel_2 = Panel("""0.3
0.5
0.2""")
dash = DashPattern(Curve=data_2, Pattern=panel_2)  # -> Dashes, Gaps
colour_swatch = ClusterOutput(ColourSwatch(SwatchColor=RGB(0, 0, 0)))
D = ClusterOutput(dash.Dashes)
panel_3 = ClusterOutput("0.5")
geometry = ClusterOutput(move.Geometry)
paths = ClusterOutput(tree_statistics_3.Paths)

# ==== cluster Cluster_5
relay = ClusterInput()

curve = Curve(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)
data = Data(relay)
area = Area(Geometry=curve)  # -> Area, Centroid
subtraction = Subtraction(A=data, B=area.Centroid)
surface = Surface(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)
graft_tree = GraftTree(Tree=subtraction, IncludeEmptyLists=True, IncludeNullItems=True)
move = Move(Geometry=surface, Motion=graft_tree)  # -> flatten(Geometry), Transform

geometry = ClusterOutput(move.Geometry)
colour_swatch = ClusterOutput(ColourSwatch(SwatchColor=RGB(160, 181, 136)))

# ==== cluster Cluster_7
geometry = ClusterInput()
curve = ClusterInput()

# ----
# preview outline
cluster = Cluster_6(curve=curve)

brep = ClusterOutput(cluster)
colour_swatch = ClusterOutput(ColourSwatch(SwatchColor=RGB(0, 0, 0)))
series = Series(Start="-3", Step="-3", Count="4")
construct_point = ConstructPoint(XCoordinate="5", YCoordinate=series, ZCoordinate=0)
test_locs = ClusterOutput(construct_point)

# ---- group: save preview results
bounding_rectangle = BoundingRectangle(Geometry=geometry, Plane=PlaneXY(0, 0, 0), Axis=0, Slide=0, Union=True)  # -> Bounding, DimensionX, DimensionY
rectangle = Rectangle(bounding_rectangle.Bounding)
boolean_toggle = BooleanToggle(True)

# ----
subtraction = Subtraction(A=bounding_rectangle.DimensionY, B=5)
addition = Addition(A=bounding_rectangle.DimensionX, B=5)
addition_2 = Addition(A=bounding_rectangle.DimensionX, B="15")
data = Data(flatten([bounding_rectangle.Bounding, construct_point]))
bounding_rectangle_2 = BoundingRectangle(Geometry=data, Plane=PlaneXY(0, 0, 0), Axis=0, Slide=0, Union=True)  # -> Bounding, DimensionX, DimensionY

# ---- group: save preview results (continued)
offset_curve = OffsetCurve(Curve=bounding_rectangle_2.Bounding, Distance="3", Corners=1)

# ----
curve_2 = ClusterOutput(offset_curve)

# ==== cluster Cluster_8
x_coordinate = ClusterInput()
y_coordinate = ClusterInput()
construct_point = ConstructPoint(XCoordinate=graft(x_coordinate), YCoordinate=y_coordinate, ZCoordinate=0)
curve = ClusterInput()
panel = Panel(ClusterInput())
point_in_curve = PointInCurve(Point=construct_point, Curve=curve)  # -> Relationship, Point
equality = Equality(FirstNumber=point_in_curve.Relationship, SecondNumber="0")  # -> Equality, Inequality
dispatch = Dispatch(List=construct_point, DispatchPattern=equality.Inequality)  # -> ListA, ListB
data = Data(dispatch.ListA)

division = Division(A="0.5", B=-2)
unit_x = UnitX(Factor=division)
unit_y = UnitY(Factor=division)
addition = Addition(A=unit_x, B=unit_y)
move = Move(Geometry=data, Motion=addition)  # -> Geometry, Transform

circle = Circle(Plane=data, Radius=".3")
rectangle = Rectangle(Plane=move.Geometry, XSize="0.5", YSize="0.5", Radius=0)  # -> Rectangle, Length
# display columns
surface = Surface(circle)
colour_swatch = ClusterOutput(ColourSwatch(SwatchColor=RGB(0, 15, 51)))
surface_2 = ClusterOutput(surface)

# ==== cluster Cluster_2
i = ClusterInput()
T = ClusterInput()

geo = Geometry([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])
join = JoinCurves(Curves=geo, Preserve=False)
geo_2 = Geometry([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])
geo_3 = Geometry([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])
geo_4 = Geometry([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])
geo_5 = Geometry([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])
geo_6 = Geometry([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])
group = Group(Objects=geo)
group_2 = Group(Objects=geo_4)
group_3 = Group(Objects=geo_3)
group_4 = Group(Objects=geo_6)
group_5 = Group(Objects=geo_5)
group_6 = Group(Objects=geo_2)
merge = Merge(Data1=group, Data2=group_2, Data3=group_3, Data4=group_4, Data5=group_5, Data6=group_6)
item = ListItem(List=merge, Index=i, Wrap=True)
scale = Scale(Geometry=item, Center=Point(0, 0, 0), Factor="5")  # -> Geometry, Transform
move = Move(Geometry=scale.Geometry, Motion=T)  # -> Geometry, Transform
rotate = Rotate(Geometry=move.Geometry, Angle="pi/2", Plane=PlaneXY(0, 0, 0))  # -> Geometry, Transform

G = ClusterOutput(rotate.Geometry)

# ==== cluster Cluster_6
curve = ClusterInput()
data = ClusterInput()
simplify_curve = SimplifyCurve(Curve=curve)  # -> Curve, Simplified
data_2 = Data(data)
offset_curve = OffsetCurve(Curve=simplify_curve.Curve, Distance=".3", Corners=1)
end_points = EndPoints(Curve=simplify_curve.Curve)  # -> Start, End
end_points_2 = EndPoints(Curve=offset_curve)  # -> Start, End
line = Line(StartPoint=end_points_2.Start, EndPoint=end_points.Start)
sweep2 = Sweep2(Rail1=simplify_curve.Curve, Rail2=offset_curve, Sections=line, SameHeight=False)
brep = ClusterOutput(sweep2)
